# Grasshopper definition m-06.gh (Grasshopper 0.9.76)
# plug-ins: Python Interpreter, HDTReference

file_path = FilePath("C:\Users\danil\Documents\GitHub\gda\dummy data\d-11 Team assignment data.pkl")
file_path_2 = FilePath("C:\Users\danil\Documents\GitHub\gda\dummy data\d-10 graph data.pkl")
file_path_3 = FilePath("C:\Users\danil\Documents\GitHub\gda\data\-team_data.json")
file_path_4 = FilePath("C:\Users\danil\Documents\GitHub\gda\dummy data\d-09 neighborhood data.pkl")
python = PythonScript(x=file_path)  # -> a
# ---------- python: Python ----------
import pickle

data = pickle.load( open(x, 'rb') )

print data

a = pickle.dumps(data)
# ---------- end python ----------
python_2 = PythonScript(x=file_path_2)  # -> a
# ---------- python_2: Python ----------
import pickle

data = pickle.load( open(x, 'rb') )

a = pickle.dumps(data)
# ---------- end python_2 ----------
python_3 = PythonScript(x=file_path_4)  # -> a
# ---------- python_3: Python ----------
import pickle

data = pickle.load( open(x, 'rb') )

a = pickle.dumps(data["amenities"])
# ---------- end python_3 ----------
python_4 = PythonScript()  # -> path
# ---------- python_4: Python ----------
import pickle

path = ghenv.LocalScope.ghdoc.Path
path = path.split("\\")
path = "\\".join(path[:-3]) + "\\python resources"
# ---------- end python_4 ----------
dijkstra = PythonScript(resource_path=python_4, a_data=python_3, g=python_2, t=python, t_pref=file_path_3)  # -> out, pts, vals, lines, lines_val
# ---------- dijkstra: Python ----------
from __future__ import generators
import pickle
import json
import rhinoscriptsyntax as rs

import sys
sys.path.append(resource_path)
from dijkstra import Dijkstra

graph = pickle.loads(g)
am_data = pickle.loads(a_data)
team_data = pickle.loads(t)

with open(t_pref, 'r') as f:
    team_pref = json.load(f)

edge_traversal = {}

def mutateGraph(P, start, end):
    # calculate path
    Path = []
    while True:
        Path.append(end)
        if end == start: break
        end = P[end]
    Path.reverse()
    
    # add node traversal
    for node in Path[1:-1]:
        if "traversal" not in graph["nodes"][node].keys():
            graph["nodes"][node]["traversal"] = 0
        graph["nodes"][node]["traversal"] += 1
    
    # add edge traversal
    for j, node2 in enumerate(Path[1:]):
        node1 = Path[j]
        if node1 not in edge_traversal.keys():
            edge_traversal[node1] = {}
        if node2 not in edge_traversal[node1].keys():
            edge_traversal[node1][node2] = 0
        edge_traversal[node1][node2] += 1
    return Path


print team_pref[team_pref.keys()[0]]

# iterate through all teams
for m, manager1 in enumerate(team_pref.keys()):
    
    # calculate team to team preference
    for pref in [0, 1, 2]:
        for n, manager2 in enumerate(team_pref[manager1]['adjacency-teams'][pref]):
#            print m, manager1, '-->', n, manager2
            
            try:
                desks1 = team_data[manager1]
                desks2 = team_data[manager2]
                
                totalCost = 0
                for d1 in desks1:
                    D, P = Dijkstra(graph["edges"], d1, end)
                    
                    for d2 in desks2:
                        mutateGraph(P, d1, d2)
                    
                    totalCost += (sum([D[x] for x in desks2])/len(desks2))
                
                print "total cost:", totalCost
                
                break
                
            except KeyError as e:
                print "key not found:", e
        break
    
    # calculate team to amenity preference
    for pref in [0, 1, 2]:
        for n, amenity in enumerate(team_pref[manager1]['adjacency-amenity'][pref]):
#            print m, manager1, '-->', n, amenity
            
            try:
                desks1 = team_data[manager1]
                amenity_loc = am_data[amenity]
                
                totalCost = 0
                
                for desk in desks1:
                    D, P = Dijkstra(graph["edges"], desk, end)
                    mutateGraph(P)
                    totalCost += (sum([D[x] for x in amenity_loc])/len(amenity_loc))
                
                print "total cost:", totalCost
                
                break
                
            except KeyError as e:
                print "key not found:", e
        break

pts = []
vals = []

lines_dict = {}

for node in graph["nodes"]:
    if "traversal" in node.keys():
        pts.append(rs.AddPoint(node["coords"]))
        vals.append(node["traversal"])

for node1 in edge_traversal.keys():
    for node2 in edge_traversal[node1].keys():
        traversal = edge_traversal[node1][node2]
        if (node2, node1) in lines_dict.keys():
            lines_dict[(node2, node1)] += traversal
        else:
            if (node1, node2) not in lines_dict.keys():
                lines_dict[(node1, node2)] = 0
            lines_dict[(node1, node2)] += traversal

lines = []
lines_val = []

for key in lines_dict.keys():
    print key
    lines.append(rs.AddLine(graph["nodes"][key[0]]["coords"], graph["nodes"][key[1]]["coords"]))
    lines_val.append(lines_dict[key])
# ---------- end dijkstra ----------
division = Division(A=dijkstra.vals, B=Slider(358.3, range=0..1000))
cluster = Cluster(num=dijkstra.vals)  # -> C, R
circle = CircleCNR(Center=dijkstra.pts, Normal=Vector(0, 0, 1), Radius=division)
cluster_2 = Cluster(num=dijkstra.lines_val)  # -> C, R
boundary = BoundarySurfaces(Edges=graft(circle))
addition = Addition(A=cluster_2.R, B=Slider(1, range=0..1))
preview = CustomPreview(Geometry=boundary, Shader=graft(cluster.C))
multiplication = Multiplication(A=addition, B=Slider(2.4, range=0..10))
previewlw = CustomPreviewLineweights(Geometry=dijkstra.lines, Shader=cluster_2.C, Thickness=multiplication)

# ==== cluster Cluster
num = ClusterInput()
num_2 = Number(num)
bnd = Bounds(Numbers=num_2)
dedomain = DeconstructDomain(Domain=bnd)  # -> Start, End
remap = RemapNumbers(Value=num_2, Source=bnd, Target=Domain(0, 1))  # -> Mapped, Clipped
gradient = Gradient(
    LowerLimit=dedomain.Start,
    UpperLimit=dedomain.End,
    Parameter=num_2,
    stops=[0: RGB(0, 128, 0), 0.5: RGB(255, 255, 0), 1: RGB(255, 0, 0)])
C = ClusterOutput(gradient)
R = ClusterOutput(remap.Mapped)
